# Grasshopper definition Analyze Slope.gh (Grasshopper 1.0.7)
# plug-ins: MeshEdit Components

# ---- group: Inputs
vis_distanc_from_the_inpuy_surfae = Slider(1, range=0..10)
number_slider = Slider(20, range=0..100)
number_slider_2 = Slider(20, range=0..100)
# Description: This Grasshopper file gets a brep geometry (with no overhangs) and analyze the slopes of that geometry based on a grid of probs. It outputs the slope percentages as well as vector and mesh visualizations.
srf = Surface(<surface referenced from the Rhino model>)

# ---- group: Creating Control Points Grid
bbox = BoundingBox(Content=srf, Plane=PlaneXY(0, 0, 0), UnionBox=True)  # -> Box, Box_2
debox = DeconstructBox(Box=bbox.Box)  # -> Plane, X, Y, Z
rectangle = Rectangle(Plane=debox.Plane, XSize=debox.X, YSize=debox.Y, Radius=0)  # -> Rectangle, Length
area = Area(Geometry=rectangle.Rectangle)  # -> Area, Centroid
scale = Scale(Geometry=rectangle.Rectangle, Center=area.Centroid, Factor=Slider(0.99, range=0..1))  # -> Geometry, Transform
boundary = BoundarySurfaces(Edges=scale.Geometry)
sdivide = DivideSurface(Surface=boundary, UCount=number_slider, VCount=number_slider_2)  # -> Points, Normals, Parameters
xy = XYPlane(Origin=Point(0, 0, 0))
project = Project(Geometry=sdivide.Points, Plane=xy)  # -> Geometry, Transform

# ----
Z = UnitZ(Factor=vis_distanc_from_the_inpuy_surfae)

# ---- group: Geometry
srf_2 = Surface(srf)

# ---- group: Tol
panel = Panel(".001")

# ---- group: Finding Probs On The Surface
Z_2 = UnitZ(Factor=1)
srf_3 = Surface(srf)
project_2 = ProjectPoint(Point=project.Geometry, Direction=expr("-x", Z_2), Geometry=srf_3)  # -> graft(Point), Index
project_3 = ProjectPoint(Point=project.Geometry, Direction=Z_2, Geometry=srf_3)  # -> graft(Point), Index
merge = Merge(Data1=project_3.Point, Data2=project_2.Point)
clean = CleanTree(RemoveNulls=True, RemoveInvalid=True, RemoveEmpty=False, Tree=merge)  # -> flatten(Tree)
cullpt = CullDuplicates(Points=clean, Tolerance=0.1, CullMode=3)  # -> Points, Indices, Valence

# ---- group: Probes
pt = Point(cullpt.Points)

pt_2 = Point(flatten(pt))

pt_3 = Point(pt)

# ----
move = Move(Geometry=pt_3, Motion=Z)  # -> Geometry, Transform

# ---- group: Probes
pt_4 = Point(pt)

# ---- group: Creating The Slope Vectors
Z_3 = UnitZ(Factor=panel)
move_2 = Move(Geometry=pt_4, Motion=expr("-x", Z_3))  # -> Geometry, Transform
srf_cp = SurfaceClosestPoint(Point=move_2.Geometry, Surface=srf_2)  # -> Point, UVPoint, Distance
vec2pt = Vector2Pt(PointA=pt_4, PointB=srf_cp.Point, Unitize=False)  # -> Vector, Length

# ----
pt_5 = Point(flatten(move.Geometry))

# ---- group: Slope Vectors
vec_slope = Vector(vec2pt.Vector)

vec_slope_2 = Vector(vec_slope)

# ----
unit = UnitVector(Vector=vec_slope_2)

# ---- group: Calculating Slope Percentages
devec = DeconstructVector(Vector=unit)  # -> XComponent, YComponent, ZComponent
vec = VectorXYZ(XComponent=devec.XComponent, YComponent=devec.YComponent, ZComponent=0)  # -> Vector, Length
vlen = VectorLength(Vector=vec.Vector)
abs = Absolute(Value=devec.ZComponent)
division = Division(A=abs, B=vlen)  # -> flatten(Result)
multiplication = Multiplication(A=division, B="100")

# ---- group: Slope Vectors Vis
dom = ConstructDomain(DomainStart=Slider(2, range=0..10), DomainEnd=Slider(1.6, range=0..10))
remap = RemapNumbers(Value=division, Source=Domain(0, 1), Target=dom)  # -> Mapped, Clipped
gradient = Gradient(LowerLimit=0, UpperLimit=1, Parameter=division, stops=[0: RGB(0, 128, 0), 0.5: RGB(255, 255, 0), 1: RGB(255, 0, 0)])
multiplication_2 = Multiplication(A=remap.Mapped, B=flatten(unit))
vdisex = VectorDisplayEx(Point=flatten(pt_5), Vector=multiplication_2, Colour=gradient, Width="4")

# ---- group: Mesh Vis
srf_4 = Surface(srf)
mesh_uv = MeshSurface(Surface=srf_4, UCount=number_slider, VCount=number_slider_2, Overhang=True, Equalize=False)
mcol = MeshColours(Mesh=mesh_uv, Colours=gradient)
frompoints = MeshFromPoints(Points=pt_2, UDirection=expr("x+1", <missing>), VDirection=expr("x+1", <missing>), Colour=<missing>)

# ----
slope_percentages = Integer(multiplication)
tag = TextTag3D(
    Location=pt_5,
    Text=slope_percentages,
    Size=Slider(1, range=0..10),
    Colour=ColourSwatch(SwatchColor=RGB(0, 0, 0)),
    Justification=8)

# ---- group: Out
slope_percentages_2 = Panel(slope_percentages)
pt_6 = Point(pt)
vec_2 = Vector(multiplication_2)
mesh = Mesh(mcol)
